vi "BPSK_FEC.gvi"   [LabVIEW Communications System Design Suite 2.0.1]
panel controls:
  "IQ rate": f64 = 200000
  "device names": "niUSRPClass"
  "carrier frequency": f64 = 400000000
  "gain Tx": f64
  "active antenna Tx": string = "TX1"
  "stop Tx": bool
  "gain Rx": f64
  "active antenna Rx": string = "RX2"
  "total bits": i32 = 128
  "symbol rate": f64
  "pulse shaping filter": T2 = "Root Raised Cos"
panel indicators:
  "Baseband Waveform": waveform<f64>
  "Baseband Power Spectrum_tx": T1
  "L": f64
  "1/Tx": f64
  "1/T": f64
  "No samples": i32
  "Baseband Power Spectrum_rx": T1
  "M": f64
  "output bits": i16[]
  "message": i8[]
  "trigger found?": bool
  "BER": f64
  "Array": i8[]
types:
  T1 = cluster{"f0": f64, "df": f64, "magnitude": f64[]}
  T2 = enum{"none", "Raised Cosine", "Root Raised Cos", "Gaussian"}
uses:
  NI::Analysis::Resampling::Upsample (DBL).gvi
  NI::Analysis::Operations::1D Convolution (DBL).gvi
  NI::Analysis::Resampling::Decimate (single shot, CDB).gvi
diagram:
  call "MT Generate Bits (Fibonacci, PN Order).gvi"(total bits=$"total bits") -> (output bit stream=w1)
  for {
    w2 = each element of w1
    for (N = 3) {
      Is Greater Than 0(x=w2) -> w4
      Select(s=w4, t=w2, f=-1) -> w5
    }
    append w5 to w3
  }
  $Array <- w3
  $message <- w1
  call "AddFrameHeader.gvi"(array=w3) -> (output array=w6)
  Divide(x=$"IQ rate", y=$"symbol rate") -> w7
  call "Upsample (DBL).gvi"(input array=w6, upsampling factor=w7) -> (upsampled array=w8)
  call "MT Generate Filter Coefficients.gvi"(pulse shaping filter=$"pulse shaping filter", pulse shaping samples per symbol=w7, modulation type="PSK") -> (pulse shaping filter coefficients=w9)
  call "1D Convolution (DBL).gvi"(x=w8, y=w9) -> (x * y=w10)
  call "Quick Scale 1D.gvi"(X=w10) -> (Y[i]=X[i]/Max|X|=w11)
  Build Waveform Node(Y=w11, dt=$"IQ rate") -> (output waveform=w12)
  $"Baseband Waveform" <- w12
  w13 = cluster{"t0": timestamp, "dt": f64, "Y": c128[]} {all zero or empty}
  Property Node(instance in=w13, "dt"=$"IQ rate", "Y"=w11) -> (instance out=w14)
  call "FFT Power Spectrum for 1 Chan (CDB)2.gvi"(time signal=w14, dB On (F)=TRUE) -> (power spectrum=w15)
  $"Baseband Power Spectrum_tx" <- w15
  $L <- w7
  $"1/Tx" <- $"IQ rate"
  $"1/T" <- $"symbol rate"
  Real And Imaginary To Complex(x=w11, y=0) -> w16
  call "Insert Pilots.gvi"(signal input=w16) -> (output signal=w17)
  call "AddFrameHeader (complex).gvi"(array=w17) -> (output array=w18)
  Array Size(array=w18) -> (size(s)=w19)
  Multiply(w19, 2) -> w20
  call "niUSRP Open Rx Session.gvi"(device names=$"device names") -> (error out=w21, session handle out=w22)
  call "niUSRP Configure Signal.gvi"(session handle=w22, IQ rate=$"IQ rate", carrier frequency=$"carrier frequency", gain=$"gain Rx", error in=w21, active antenna=$"active antenna Rx") -> (session handle out=w23, coerced carrier frequency=w24, error out=w25)
  Subtract(x=w24, y=20000) -> w26
  Property Node(instance in=w23, "LO Frequency"=w26) -> (instance out=w27)
  call "niUSRP Initiate.gvi"(session handle=w27, error in=w25) -> (session handle out=w28, error out=w29)
  call "niUSRP Fetch Rx Data (CDB).gvi"(session handle=w28, number of samples=w20, error in=w29) -> (session handle out=w30, data=w31, error out=w32)
  call "niUSRP Close Session.gvi"(session handle=w30, error in=w32)
  $"No samples" <- w19
  call "niUSRP Open Tx Session.gvi"(device names=$"device names") -> (session handle out=w33, error out=w34)
  call "niUSRP Configure Signal.gvi"(session handle=w33, IQ rate=$"IQ rate", carrier frequency=$"carrier frequency", gain=$"gain Tx", error in=w34, active antenna=$"active antenna Tx") -> (session handle out=w35, error out=w36)
  while {
    call "niUSRP Write Tx Data (CDB).gvi"(session handle=w35, data=w18, error in=w36) -> (session handle out=w37, error out=w38)
    stop if $"stop Tx"
  }
  call "niUSRP Close Session.gvi"(session handle=w37, error in=w38)
  $M <- w7
  call "FrameSync.gvi"(Sampled Input=w31) -> (Aligned Samples=w39)
  call "Channel Estimator.gvi"(input signal=w39) -> (signal out=w40)
  Complex To Real Imaginary(x + iy=w40) -> (x=w41)
  call "MT Generate Filter Coefficients.gvi"(pulse shaping filter="Root Raised Cos", matched samples per symbol=w7, modulation type="PSK") -> (matched filter coefficients=w42)
  call "1D Convolution (DBL).gvi"(x=w42, y=w41) -> (x * y=w43)
  w44 = cluster{"t0": timestamp, "dt": f64, "Y": c128[]} {all zero or empty}
  Property Node(instance in=w44, "dt"=$"IQ rate", "Y"=w43) -> (instance out=w45)
  call "FFT Power Spectrum for 1 Chan (CDB)2.gvi"(time signal=w45, dB On (F)=TRUE) -> (power spectrum=w46)
  $"Baseband Power Spectrum_rx" <- w46
  call "PulseAlign.gvi"(Input signal=w43, Receiver Sampling Factor=w7) -> (aligned output=w47)
  call "Decimate (single shot, CDB).gvi"(input array=w47, decimating factor=w7) -> (decimated array=w48)
  call "FrameSync.gvi"(Sampled Input=w48) -> (Aligned Samples=w49)
  for {
    w50 = each element of w49
    Complex To Real Imaginary(x + iy=w50) -> (x=w52)
    Is Greater Than 0(x=w52) -> w53
    append w53 to w51
  }
  Boolean To Integer(Boolean=w51) -> (0, 1=w54)
  Multiply($"total bits", 3) -> w55
  Array Subset(array=w54, index0=0, length0=w55) -> w56
  call "FEC Decoder.gvi"(data_in=w56) -> (output=w57)
  call "MT Calculate BER After Trigger (Fibonacci PN Sequence).gvi"(input bit stream=w57, BER trigger threshold=0.4) -> (BER=w58, trigger found?=w59)
  $BER <- w58
  $"trigger found?" <- w59
  $"output bits" <- w57
